% Simulink data dictionary GlobalTypes.sldd

DynamicModelBus = Simulink.Bus()  % 动力学模型给出的真实状态
  Position_NED: single[3], Unit="m"  % 位置(北东地)
  Velocity_NED: single[3], Unit="m/s"  % 速度(北东地)
  Attitude_quat: single[4]  % 四元数[w x y z]
  AngularRate_Body: single[3], Unit="rad/s"  % 机体角速度
  Accel_Body: single[3], Unit="m/s^2"  % 机体加速度(不含重力)

EscCmdBus = Simulink.Bus()  % 飞控至动力系统的电调控制指令
  MotorCmd: single[4], Unit="1"  % 各电机油门指令（归一化）
  Armed: boolean  % 执行器解锁状态，false时必须输出disarmed安全值
  Valid: boolean  % 当前执行器指令是否有效，false时禁止保持旧命令

ExperimentTraceBus = Simulink.Bus()  % Minimal experiment trace combining runtime truth, sensor input, estimator output, and actuator command
  SourceId: uint16  % Runtime source identifier
  Sequence: uint32  % Runtime frame sequence number
  Timestamp: double, Unit="s"  % Runtime simulation timestamp
  Valid: boolean  % Trace validity flag
  TruthPosition_NED: single[3], Unit="m"  % Runtime truth position in NED frame
  TruthVelocity_NED: single[3], Unit="m/s"  % Runtime truth velocity in NED frame
  IMUAccel: single[3], Unit="m/s^2"  % IMU measured specific force
  IMUGyro: single[3], Unit="rad/s"  % IMU measured angular rate
  IMUValid: boolean  % IMU frame validity flag
  GPS_LLA: single[3]  % GPS latitude, longitude, altitude measurement
  GPSVelocity: single[3], Unit="m/s"  % GPS velocity measurement
  GPSValid: boolean  % GPS frame validity flag
  StatePosition_NED: single[3], Unit="m"  % Estimator position output
  StateVelocity_NED: single[3], Unit="m/s"  % Estimator velocity output
  EscMotorCmd: single[4]  % FlightCore normalized motor command output
  PositionError_NED: single[3], Unit="m"  % Estimator position minus runtime truth position
  VelocityError_NED: single[3], Unit="m/s"  % Estimator velocity minus runtime truth velocity

FlightCmdBus = Simulink.Bus()  % 飞控统一命令接口（位置、速度、航向、模式、解锁请求和有效标志）
  Position_NED_SP: single[3], Unit="m"  % NED位置目标
  Velocity_NED_SP: single[3], Unit="m/s"  % NED速度前馈目标
  Yaw_SP: single, Unit="rad"  % 航向目标
  Mode: uint8  % 命令模式（1=位置保持）
  ArmRequest: boolean  % 解锁请求；不等于实际Armed状态
  Valid: boolean  % 命令有效标志

GPS_BUS = Simulink.Bus()  % GPS sensor measurement frame
  Lat: single, Unit="deg"  % Latitude
  Lon: single, Unit="deg"  % Longitude
  Alt: single, Unit="m"  % Altitude
  Velocity: single[3], Unit="m/s"  % NED-frame velocity
  Valid: boolean  % Frame measurement validity flag
  Timestamp: double, Unit="s"  % Measurement sample timestamp
  IsNew: boolean  % GPS msg is new

IMU_BUS = Simulink.Bus()  % IMU sensor raw measurement frame
  Accel: single[3], Unit="m/s^2"  % Body-frame specific force
  Gyro: single[3], Unit="rad/s"  % Body-frame angular rate
  Valid: boolean  % Frame measurement validity flag
  Timestamp: double, Unit="s"  % Measurement sample timestamp
  IsNew: boolean  % IMU msg is new

RuntimeTruthBus = Simulink.Bus()  % Runtime truth state for trace and estimator comparison; not a FlightCore input
  SourceId: uint16  % Runtime source identifier
  Sequence: uint32  % Runtime frame sequence number
  Timestamp: double, Unit="s"  % Runtime simulation timestamp
  Position_NED: single[3], Unit="m"  % Truth position in NED frame
  Velocity_NED: single[3], Unit="m/s"  % Truth velocity in NED frame
  Valid: boolean  % Truth frame validity flag

StateEstBus = Simulink.Bus()  % ESKF导航状态估计（位置、速度、姿态、偏置等）
  Position_NED: single[3], Unit="m"  % 位置估计（北东地）
  Velocity_NED: single[3], Unit="m/s"  % 速度估计（北东地）
  Attitude_quat: single[4]  % 姿态四元数 [w x y z]
  AngularRate_Body: single[3], Unit="rad/s"  % 机体角速度估计
  Accel_Body: single[3], Unit="m/s^2"  % 机体加速度估计（不含重力）
  GyroBias: single[3], Unit="rad/s"  % 陀螺零偏估计
  AccelBias: single[3], Unit="m/s^2"  % 加速度计零偏估计
  Wind_NED: single[3], Unit="m/s"  % 风速估计（北东地）
  Status: uint8  % 估计器状态（0未初始化,1稳定,2错误）

ThrustTorqueBus = Simulink.Bus()  % 动力系统输出的合力与合力矩（机体坐标系）
  Thrust_Body: single[3], Unit="N"  % 机体推力 [Fx, Fy, Fz]
  Torque_Body: single[3], Unit="N*m"  % 机体力矩 [Mx, My, Mz]