% Simulink data dictionary SimulationDict.sldd
% references GlobalTypes.sldd
% references VehicleDict.sldd

SIM_INIT_POS_NED = Simulink.Parameter(single([0; 0; -2]), StorageClass="ExportedGlobal")  % 闭环悬停仿真的动力学初始位置，NED坐标系，下为正。
SIM_INIT_VEL_NED = Simulink.Parameter(single([0; 0; 0]), StorageClass="ExportedGlobal")  % 闭环悬停仿真的动力学初始速度。
SIM_INIT_QUAT_NB = Simulink.Parameter(single([1; 0; 0; 0]), StorageClass="ExportedGlobal")  % 闭环悬停仿真的初始姿态四元数 [qw, qx, qy, qz]。
SIM_INIT_OMEGA_BODY = Simulink.Parameter(single([0; 0; 0]), StorageClass="ExportedGlobal")  % 闭环悬停仿真的机体系初始角速度。
SIM_ENABLE_SENSOR_NOISE = Simulink.Parameter(false, StorageClass="ExportedGlobal", DataType="boolean")  % 最小闭环悬停验收默认关闭传感器噪声。
SIM_STOP_TIME = Simulink.Parameter(2, StorageClass="ExportedGlobal", DataType="double")  % 最小闭环悬停验收默认仿真停止时间。