% Simulink data dictionary CommandDict.sldd
% references GlobalTypes.sldd

CMD_HOVER_POS_NED = Simulink.Parameter(single([0; 0; -2]), StorageClass="ExportedGlobal")  % 默认悬停位置目标，NED坐标系，下为正。
CMD_HOVER_VEL_NED = Simulink.Parameter(single([0; 0; 0]), StorageClass="ExportedGlobal")  % 默认悬停速度前馈目标。
CMD_HOVER_YAW = Simulink.Parameter(single(0), StorageClass="ExportedGlobal")  % 默认悬停航向目标。
CMD_MODE_POS_HOLD = Simulink.Parameter(uint8(1), StorageClass="ExportedGlobal")  % 位置保持模式枚举值。
CMD_HOVER_VALID = Simulink.Parameter(true, StorageClass="ExportedGlobal", DataType="boolean")  % 默认悬停命令有效标志。
CMD_SAMPLE_TIME = Simulink.Parameter(0.001, StorageClass="ExportedGlobal", DataType="double")  % 命令模块显式离散采样时间，与控制器快速路径一致。