% Simulink data dictionary PowerSystemDict.sldd
% references GlobalTypes.sldd
% references VehicleDict.sldd

motorMaxThrust_N = Simulink.Parameter(single(4.17944622), StorageClass="ExportedGlobal")  % AirSim Generic Quad 单旋翼最大推力。normalized command 1.0 线性对应此推力
motorMaxReactionTorque_Nm = Simulink.Parameter(single(0.055562), StorageClass="ExportedGlobal")  % AirSim Generic Quad 单旋翼最大反扭矩。normalized command 1.0 线性对应此反扭矩
motorTimeConstant_s = Simulink.Parameter(single(0.005), StorageClass="ExportedGlobal")  % AirSim RotorActuator normalized control signal 一阶低通时间常数