% Simulink data dictionary SensorDict.sldd
% references GlobalTypes.sldd
% references VehicleDict.sldd

IMU_ACC_NOISE = Simulink.Parameter(single(0.001), StorageClass="ExportedGlobal")  % 加速度计白噪声密度。Band-Limited White Noise 块的噪声强度
IMU_GYR_NOISE = Simulink.Parameter(single(0.0001), StorageClass="ExportedGlobal")  % 陀螺仪白噪声密度。Band-Limited White Noise 块的噪声强度
IMU_ACC_BIAS = Simulink.Parameter(single([0.05; -0.03; 0.08]), StorageClass="ExportedGlobal")  % 加速度计三轴常值偏置 [x, y, z]
IMU_GYR_BIAS = Simulink.Parameter(single([0.001; -0.002; 0.001]), StorageClass="ExportedGlobal")  % 陀螺仪三轴常值偏置 [x, y, z]
IMU_ACC_BIAS_WALK = Simulink.Parameter(single(0.0001), StorageClass="ExportedGlobal")  % 加速度计偏置随机游走噪声密度
IMU_GYR_BIAS_WALK = Simulink.Parameter(single(1.0e-5), StorageClass="ExportedGlobal")  % 陀螺仪偏置随机游走噪声密度
IMU_ACC_SCALE = Simulink.Parameter(single(0.002), StorageClass="ExportedGlobal")  % 加速度计比例因子误差（无量纲百分比）。输出 = true * (1 + SCALE)
IMU_GYR_SCALE = Simulink.Parameter(single(0.002), StorageClass="ExportedGlobal")  % 陀螺仪比例因子误差（无量纲百分比）。输出 = true * (1 + SCALE)
IMU_SAT_ACC = Simulink.Parameter(single(156.96), StorageClass="ExportedGlobal")  % 加速度计量程上限（±值）。默认 ±16g = ±156.96 m/s²
IMU_SAT_GYR = Simulink.Parameter(single(34.907), StorageClass="ExportedGlobal")  % 陀螺仪量程上限（±值）。默认 ±2000°/s = ±34.907 rad/s
IMU_SAMPLE_RATE = Simulink.Parameter(single(1000), StorageClass="ExportedGlobal")  % IMU 采样率。与模型固定步长一致
GPS_POS_H_NOISE = Simulink.Parameter(single(0.5), StorageClass="ExportedGlobal")  % GPS 水平位置噪声标准差 (1σ)。N/E 分量共用
GPS_POS_V_NOISE = Simulink.Parameter(single(1), StorageClass="ExportedGlobal")  % GPS 垂直位置噪声标准差 (1σ)。通常 ≥ 1.5× 水平噪声
GPS_VEL_NOISE = Simulink.Parameter(single(0.1), StorageClass="ExportedGlobal")  % GPS 速度噪声标准差 (1σ)。三轴共用
GPS_SAMPLE_RATE = Simulink.Parameter(single(5), StorageClass="ExportedGlobal")  % GPS 更新率。通过 Rate Transition 实现降频
GPS_REF_LAT = Simulink.Parameter(single(0), StorageClass="ExportedGlobal")  % Flat Earth to LLA 参考纬度。NED 坐标系原点
GPS_REF_LON = Simulink.Parameter(single(10), StorageClass="ExportedGlobal")  % Flat Earth to LLA 参考经度。NED 坐标系原点